# Grasshopper definition testgh.gh (Grasshopper 1.0.7)
# plug-ins: GHCITest Info

B = GetNumber(Slider(10, range=0..10), AtLeast=1, AtMost=2147483647, Maximum=1.797693135e+308, Minimum=-1.797693135e+308)
A = GetNumber(Slider(10, range=0..10), AtLeast=1, AtMost=2147483647, Maximum=1.797693135e+308, Minimum=-1.797693135e+308)
nickname = GHCITestComponent(A=A, B=B)

# ---- group: RH_OUT:Result
num = Number(nickname)
